# Grasshopper definition process_press-z.gh (Grasshopper 1.0.8)
# plug-ins: MeshEdit Components, Pufferfish, Logger, MinerGH

loggermanager = LoggerManager()
get_file_path_input_shape = GetFilePath(AtLeast=1, AtMost=1, TreeAccess=False)
number_slider = Slider(1, range=0..1)
path = FilePath(get_file_path_input_shape)
xy_plane = XYPlane(Origin=Point(0, 0, 0))
read_file = ReadFile(File=path, PerLineParse=False)
circle = Circle(Plane=xy_plane, Radius=Slider(200, range=0..1000))
circle_2 = Circle(Plane=xy_plane, Radius=Slider(300, range=0..1000))
extruct_section_shell_pid = CSharpScript(kfile_text=read_file, PID=number_slider)  # -> out, SECID, ELEFORM, T1, T2, T3, T4; inputs kfile_text: String, PID: Int32
# ---------- extruct_section_shell_pid: C# ----------
// Grasshopper Script Instance
#region Usings
using System;
using System.Linq;
using System.Collections;
using System.Collections.Generic;
using System.Drawing;
using System.Globalization;

using Rhino;
using Rhino.Geometry;

using Grasshopper;
using Grasshopper.Kernel;
using Grasshopper.Kernel.Data;
using Grasshopper.Kernel.Types;
#endregion

public class Script_Instance : GH_ScriptInstance
{
    #region Notes
    /* 
      Members:
        RhinoDoc RhinoDocument
        GH_Document GrasshopperDocument
        IGH_Component Component
        int Iteration

      Methods (Virtual & overridable):
        Print(string text)
        Print(string format, params object[] args)
        Reflect(object obj)
        Reflect(object obj, string method_name)
    */
    #endregion


    private void RunScript(
		string kfile_text,
		int PID,
		ref object SECID,
		ref object ELEFORM,
		ref object T1,
		ref object T2,
		ref object T3,
		ref object T4)
    {
        // ============================================================
        // Initial output
        // ============================================================

        SECID = null;
        ELEFORM = null;
        T1 = null;
        T2 = null;
        T3 = null;
        T4 = null;


        if (string.IsNullOrWhiteSpace(kfile_text))
        {
            Print("kfile_text is empty.");
            return;
        }


        // ============================================================
        // Split file
        // ============================================================

        string[] lines =
            kfile_text.Replace("\r\n", "\n")
                      .Replace("\r", "\n")
                      .Split('\n');


        // ============================================================
        // STEP 1
        // PID -> SECID
        //
        // *PART
        // title
        // PID SECID MID ...
        // ============================================================

        int targetSECID = -1;

        bool insidePart = false;


        for (int i = 0; i < lines.Length; i++)
        {
            string rawLine = lines[i];

            if (rawLine == null)
                continue;


            string line = rawLine.Trim();


            if (line.Length == 0)
                continue;


            // --------------------------------------------------------
            // Keyword
            // --------------------------------------------------------

            if (line.StartsWith("*"))
            {
                insidePart =
                    line.StartsWith(
                        "*PART",
                        StringComparison.OrdinalIgnoreCase
                    );

                continue;
            }


            if (!insidePart)
                continue;


            // Comment
            if (line.StartsWith("$"))
                continue;


            // --------------------------------------------------------
            // PART data
            // --------------------------------------------------------

            int partPID = 0;
            int partSECID = 0;


            if (
                TryParsePartLine(
                    rawLine,
                    out partPID,
                    out partSECID
                )
            )
            {
                if (partPID == PID)
                {
                    targetSECID = partSECID;
                    break;
                }
            }
        }


        // ============================================================
        // PID not found
        // ============================================================

        if (targetSECID < 0)
        {
            Print(
                "PID " +
                PID +
                " was not found in *PART."
            );

            return;
        }


        // ============================================================
        // STEP 2
        // Find corresponding SECTION_SHELL
        // ============================================================

        bool insideSectionShell = false;

        List<string> sectionBlock =
            new List<string>();


        for (int i = 0; i < lines.Length; i++)
        {
            string rawLine = lines[i];

            if (rawLine == null)
                continue;


            string line =
                rawLine.Trim();


            // --------------------------------------------------------
            // New keyword
            // --------------------------------------------------------

            if (line.StartsWith("*"))
            {
                // Check previous SECTION_SHELL
                if (
                    insideSectionShell &&
                    sectionBlock.Count > 0
                )
                {
                    SectionShellData data;

                    if (
                        TryParseSectionShell(
                            sectionBlock,
                            out data
                        )
                    )
                    {
                        if (data.SECID == targetSECID)
                        {
                            SetOutputs(
                                data,
                                ref SECID,
                                ref ELEFORM,
                                ref T1,
                                ref T2,
                                ref T3,
                                ref T4
                            );

                            Print("PID     : " + PID);
                            Print("SECID   : " + data.SECID);
                            Print("ELEFORM : " + data.ELEFORM);

                            return;
                        }
                    }
                }


                // Start new SECTION_SHELL
                if (
                    line.StartsWith(
                        "*SECTION_SHELL",
                        StringComparison.OrdinalIgnoreCase
                    )
                )
                {
                    insideSectionShell = true;

                    sectionBlock =
                        new List<string>();
                }
                else
                {
                    insideSectionShell = false;

                    sectionBlock =
                        new List<string>();
                }


                continue;
            }


            // --------------------------------------------------------
            // Collect section lines
            // --------------------------------------------------------

            if (insideSectionShell)
            {
                sectionBlock.Add(rawLine);
            }
        }


        // ============================================================
        // Check last SECTION_SHELL at EOF
        // ============================================================

        if (
            insideSectionShell &&
            sectionBlock.Count > 0
        )
        {
            SectionShellData data;

            if (
                TryParseSectionShell(
                    sectionBlock,
                    out data
                )
            )
            {
                if (data.SECID == targetSECID)
                {
                    SetOutputs(
                        data,
                        ref SECID,
                        ref ELEFORM,
                        ref T1,
                        ref T2,
                        ref T3,
                        ref T4
                    );

                    return;
                }
            }
        }


        // ============================================================
        // Not found
        // ============================================================

        Print(
            "*SECTION_SHELL with SECID " +
            targetSECID +
            " was not found."
        );
    }


    // ================================================================
    // SECTION_SHELL data
    // ================================================================

    private class SectionShellData
    {
        public int SECID;
        public int ELEFORM;

        public double T1;
        public double T2;
        public double T3;
        public double T4;
    }


    // ================================================================
    // Parse PART
    //
    // PID SECID MID ...
    // ================================================================

    private bool TryParsePartLine(
        string rawLine,
        out int pid,
        out int secid
    )
    {
        pid = 0;
        secid = 0;


        // ------------------------------------------------------------
        // Normal whitespace / comma separated
        // ------------------------------------------------------------

        string[] values =
            SplitLine(rawLine.Trim());


        if (values.Length >= 2)
        {
            int p = 0;
            int s = 0;


            if (
                TryParseInt(values[0], out p) &&
                TryParseInt(values[1], out s)
            )
            {
                pid = p;
                secid = s;

                return true;
            }
        }


        // ------------------------------------------------------------
        // Fixed width 10
        // ------------------------------------------------------------

        if (rawLine.Length >= 20)
        {
            int p = 0;
            int s = 0;


            if (
                TryParseInt(
                    SafeSubstring(rawLine, 0, 10),
                    out p
                ) &&
                TryParseInt(
                    SafeSubstring(rawLine, 10, 10),
                    out s
                )
            )
            {
                pid = p;
                secid = s;

                return true;
            }
        }


        // ------------------------------------------------------------
        // Fixed width 8
        // ------------------------------------------------------------

        if (rawLine.Length >= 16)
        {
            int p = 0;
            int s = 0;


            if (
                TryParseInt(
                    SafeSubstring(rawLine, 0, 8),
                    out p
                ) &&
                TryParseInt(
                    SafeSubstring(rawLine, 8, 8),
                    out s
                )
            )
            {
                pid = p;
                secid = s;

                return true;
            }
        }


        return false;
    }


    // ================================================================
    // Parse SECTION_SHELL
    //
    // Example:
    //
    // $ SECID ELFORM SHRF NIP PROPT QR/IRID ICOMP SETYP
    //        1      16 ...
    //
    // $ T1 T2 T3 T4 ...
    //      1.0 1.0 1.0 1.0 ...
    //
    // ================================================================

    private bool TryParseSectionShell(
        List<string> block,
        out SectionShellData data
    )
    {
        data =
            new SectionShellData();


        if (block == null)
            return false;


        // ------------------------------------------------------------
        // Collect only actual data lines
        // Ignore comments and empty lines
        // ------------------------------------------------------------

        List<string> dataLines =
            new List<string>();


        foreach (string rawLine in block)
        {
            if (rawLine == null)
                continue;


            string line =
                rawLine.Trim();


            if (line.Length == 0)
                continue;


            if (line.StartsWith("$"))
                continue;


            dataLines.Add(rawLine);
        }


        // SECTION_SHELL requires at least 2 data lines
        if (dataLines.Count < 2)
            return false;


        // ============================================================
        // First data line
        //
        // SECID ELFORM SHRF NIP ...
        // ============================================================

        string firstLine =
            dataLines[0];


        string[] first =
            SplitLine(
                firstLine.Trim()
            );


        int secid = 0;
        int elform = 0;

        bool firstSuccess = false;


        // ------------------------------------------------------------
        // Normal separated format
        // ------------------------------------------------------------

        if (first.Length >= 2)
        {
            if (
                TryParseInt(first[0], out secid) &&
                TryParseInt(first[1], out elform)
            )
            {
                firstSuccess = true;
            }
        }


        // ------------------------------------------------------------
        // Fixed width 10 fallback
        // ------------------------------------------------------------

        if (!firstSuccess)
        {
            int tempSec = 0;
            int tempElform = 0;


            if (
                TryParseInt(
                    SafeSubstring(firstLine, 0, 10),
                    out tempSec
                ) &&
                TryParseInt(
                    SafeSubstring(firstLine, 10, 10),
                    out tempElform
                )
            )
            {
                secid = tempSec;
                elform = tempElform;

                firstSuccess = true;
            }
        }


        // ------------------------------------------------------------
        // Fixed width 8 fallback
        // ------------------------------------------------------------

        if (!firstSuccess)
        {
            int tempSec = 0;
            int tempElform = 0;


            if (
                TryParseInt(
                    SafeSubstring(firstLine, 0, 8),
                    out tempSec
                ) &&
                TryParseInt(
                    SafeSubstring(firstLine, 8, 8),
                    out tempElform
                )
            )
            {
                secid = tempSec;
                elform = tempElform;

                firstSuccess = true;
            }
        }


        if (!firstSuccess)
            return false;


        // ============================================================
        // Second data line
        //
        // T1 T2 T3 T4 ...
        // ============================================================

        string secondLine =
            dataLines[1];


        string[] second =
            SplitLine(
                secondLine.Trim()
            );


        double t1 = 0.0;
        double t2 = 0.0;
        double t3 = 0.0;
        double t4 = 0.0;

        bool secondSuccess = false;


        // ------------------------------------------------------------
        // Normal separated format
        // ------------------------------------------------------------

        if (second.Length >= 4)
        {
            if (
                TryParseDouble(second[0], out t1) &&
                TryParseDouble(second[1], out t2) &&
                TryParseDouble(second[2], out t3) &&
                TryParseDouble(second[3], out t4)
            )
            {
                secondSuccess = true;
            }
        }


        // ------------------------------------------------------------
        // Fixed width 10 fallback
        // ------------------------------------------------------------

        if (!secondSuccess)
        {
            double temp1 = 0.0;
            double temp2 = 0.0;
            double temp3 = 0.0;
            double temp4 = 0.0;


            if (
                TryParseDouble(
                    SafeSubstring(secondLine, 0, 10),
                    out temp1
                ) &&
                TryParseDouble(
                    SafeSubstring(secondLine, 10, 10),
                    out temp2
                ) &&
                TryParseDouble(
                    SafeSubstring(secondLine, 20, 10),
                    out temp3
                ) &&
                TryParseDouble(
                    SafeSubstring(secondLine, 30, 10),
                    out temp4
                )
            )
            {
                t1 = temp1;
                t2 = temp2;
                t3 = temp3;
                t4 = temp4;

                secondSuccess = true;
            }
        }


        // ------------------------------------------------------------
        // Fixed width 8 fallback
        // ------------------------------------------------------------

        if (!secondSuccess)
        {
            double temp1 = 0.0;
            double temp2 = 0.0;
            double temp3 = 0.0;
            double temp4 = 0.0;


            if (
                TryParseDouble(
                    SafeSubstring(secondLine, 0, 8),
                    out temp1
                ) &&
                TryParseDouble(
                    SafeSubstring(secondLine, 8, 8),
                    out temp2
                ) &&
                TryParseDouble(
                    SafeSubstring(secondLine, 16, 8),
                    out temp3
                ) &&
                TryParseDouble(
                    SafeSubstring(secondLine, 24, 8),
                    out temp4
                )
            )
            {
                t1 = temp1;
                t2 = temp2;
                t3 = temp3;
                t4 = temp4;

                secondSuccess = true;
            }
        }


        if (!secondSuccess)
            return false;


        // ============================================================
        // Store result
        // ============================================================

        data.SECID = secid;
        data.ELEFORM = elform;

        data.T1 = t1;
        data.T2 = t2;
        data.T3 = t3;
        data.T4 = t4;


        return true;
    }


    // ================================================================
    // Set outputs
    // ================================================================

    private void SetOutputs(
        SectionShellData data,
        ref object SECID,
        ref object ELEFORM,
        ref object T1,
        ref object T2,
        ref object T3,
        ref object T4
    )
    {
        SECID = data.SECID;
        ELEFORM = data.ELEFORM;

        T1 = data.T1;
        T2 = data.T2;
        T3 = data.T3;
        T4 = data.T4;
    }


    // ================================================================
    // Split
    // ================================================================

    private string[] SplitLine(
        string line
    )
    {
        return line.Split(
            new char[]
            {
                ' ',
                '\t',
                ','
            },
            StringSplitOptions.RemoveEmptyEntries
        );
    }


    // ================================================================
    // Safe fixed-width substring
    // ================================================================

    private string SafeSubstring(
        string text,
        int start,
        int length
    )
    {
        if (string.IsNullOrEmpty(text))
            return "";


        if (start < 0)
            return "";


        if (start >= text.Length)
            return "";


        int available =
            Math.Min(
                length,
                text.Length - start
            );


        return text.Substring(
            start,
            available
        ).Trim();
    }


    // ================================================================
    // Integer parser
    // ================================================================

    private bool TryParseInt(
        string text,
        out int value
    )
    {
        value = 0;


        if (string.IsNullOrWhiteSpace(text))
            return false;


        return int.TryParse(
            text.Trim(),
            NumberStyles.Integer,
            CultureInfo.InvariantCulture,
            out value
        );
    }


    // ================================================================
    // Double parser
    // ================================================================

    private bool TryParseDouble(
        string text,
        out double value
    )
    {
        value = 0.0;


        if (string.IsNullOrWhiteSpace(text))
            return false;


        return double.TryParse(
            text.Trim(),
            NumberStyles.Float,
            CultureInfo.InvariantCulture,
            out value
        );
    }
}
# ---------- end extruct_section_shell_pid ----------
extruct_mesh_pid = CSharpScript(kfile_text=read_file, PID=number_slider)  # -> out, a
# ---------- extruct_mesh_pid: C# ----------
// Grasshopper Script Instance
#region Usings
using System;
using System.Linq;
using System.Collections;
using System.Collections.Generic;
using System.Drawing;
using System.Globalization;

using Rhino;
using Rhino.Geometry;

using Grasshopper;
using Grasshopper.Kernel;
using Grasshopper.Kernel.Data;
using Grasshopper.Kernel.Types;
#endregion

public class Script_Instance : GH_ScriptInstance
{
    #region Notes
    /* 
      Members:
        RhinoDoc RhinoDocument
        GH_Document GrasshopperDocument
        IGH_Component Component
        int Iteration

      Methods (Virtual & overridable):
        Print(string text)
        Print(string format, params object[] args)
        Reflect(object obj)
        Reflect(object obj, string method_name)
    */
    #endregion

    private void RunScript(object kfile_text, object PID, ref object a)
    {
        // ------------------------------------------------------------
        // x : Read File / Total File
        // y : Part ID
        // a : Rhino Mesh
        // ------------------------------------------------------------

        string text = kfile_text as string;

        if (string.IsNullOrWhiteSpace(text))
        {
            Print("Input text is empty.");
            a = null;
            return;
        }

        int targetPartId;

        try
        {
            targetPartId = Convert.ToInt32(PID);
        }
        catch
        {
            Print("Part ID must be an integer.");
            a = null;
            return;
        }


        // ============================================================
        // Storage
        // ============================================================

        Dictionary<int, Point3d> nodes =
            new Dictionary<int, Point3d>();

        List<ElementData> elements =
            new List<ElementData>();


        // ============================================================
        // Split whole file into lines
        // ============================================================

        string[] lines =
            text.Replace("\r\n", "\n")
                .Replace("\r", "\n")
                .Split('\n');


        string currentKeyword = "";

        int nodeParseFailCount = 0;


        // ============================================================
        // Parse
        // ============================================================

        foreach (string raw in lines)
        {
            if (raw == null)
                continue;

            // IMPORTANT:
            // Do NOT Trim() rawLine before fixed-width parsing.
            string rawLine = raw;

            // Only use trimmed version for checking keywords/comments
            string checkLine = rawLine.Trim();

            if (checkLine.Length == 0)
                continue;


            // --------------------------------------------------------
            // Comment
            // --------------------------------------------------------

            if (checkLine.StartsWith("$"))
                continue;


            // --------------------------------------------------------
            // Keyword
            // --------------------------------------------------------

            if (checkLine.StartsWith("*"))
            {
                currentKeyword =
                    checkLine.ToUpperInvariant();

                continue;
            }


            // ========================================================
            // NODE
            // ========================================================

            if (currentKeyword.StartsWith("*NODE"))
            {
                int nodeId = 0;

                double px = 0.0;
                double py = 0.0;
                double pz = 0.0;

                bool success = false;


                // ----------------------------------------------------
                // First:
                // Try normal whitespace / comma separated format
                // ----------------------------------------------------

                string[] values =
                    SplitLine(checkLine);

                if (values.Length >= 4)
                {
                    int tempId;
                    double tempX;
                    double tempY;
                    double tempZ;

                    if (
                        TryParseInt(values[0], out tempId) &&
                        TryParseDouble(values[1], out tempX) &&
                        TryParseDouble(values[2], out tempY) &&
                        TryParseDouble(values[3], out tempZ)
                    )
                    {
                        nodeId = tempId;
                        px = tempX;
                        py = tempY;
                        pz = tempZ;

                        success = true;
                    }
                }


                // ----------------------------------------------------
                // Second:
                // LS-DYNA fixed width NODE format
                //
                // NID : 8 chars
                // X   : 16 chars
                // Y   : 16 chars
                // Z   : 16 chars
                //
                // IMPORTANT:
                // use rawLine, NOT Trimmed string
                // ----------------------------------------------------

                if (!success)
                {
                    if (rawLine.Length >= 56)
                    {
                        string sNid =
                            SafeSubstring(rawLine, 0, 8);

                        string sX =
                            SafeSubstring(rawLine, 8, 16);

                        string sY =
                            SafeSubstring(rawLine, 24, 16);

                        string sZ =
                            SafeSubstring(rawLine, 40, 16);


                        int tempId;
                        double tempX;
                        double tempY;
                        double tempZ;


                        if (
                            TryParseInt(sNid, out tempId) &&
                            TryParseDouble(sX, out tempX) &&
                            TryParseDouble(sY, out tempY) &&
                            TryParseDouble(sZ, out tempZ)
                        )
                        {
                            nodeId = tempId;
                            px = tempX;
                            py = tempY;
                            pz = tempZ;

                            success = true;
                        }
                    }
                }


                // ----------------------------------------------------
                // Add NODE
                // ----------------------------------------------------

                if (success)
                {
                    nodes[nodeId] =
                        new Point3d(px, py, pz);
                }
                else
                {
                    nodeParseFailCount++;
                }

                continue;
            }


            // ========================================================
            // ELEMENT_SHELL
            // ========================================================

            if (currentKeyword.StartsWith("*ELEMENT_SHELL"))
            {
                string[] values =
                    SplitLine(checkLine);


                // ----------------------------------------------------
                // Normal whitespace-separated ELEMENT_SHELL
                // ----------------------------------------------------

                if (values.Length >= 5)
                {
                    int eid;
                    int pid;

                    int n1;
                    int n2;
                    int n3;
                    int n4 = 0;


                    if (!TryParseInt(values[0], out eid))
                        continue;

                    if (!TryParseInt(values[1], out pid))
                        continue;


                    if (pid != targetPartId)
                        continue;


                    if (!TryParseInt(values[2], out n1))
                        continue;

                    if (!TryParseInt(values[3], out n2))
                        continue;

                    if (!TryParseInt(values[4], out n3))
                        continue;


                    if (values.Length >= 6)
                        TryParseInt(values[5], out n4);


                    ElementData e =
                        new ElementData();

                    e.Id = eid;
                    e.PartId = pid;

                    e.N1 = n1;
                    e.N2 = n2;
                    e.N3 = n3;
                    e.N4 = n4;

                    elements.Add(e);

                    continue;
                }


                // ----------------------------------------------------
                // Fixed width ELEMENT_SHELL fallback
                //
                // EID PID N1 N2 N3 N4
                // each 8 chars
                // ----------------------------------------------------

                if (rawLine.Length >= 40)
                {
                    int eid = 0;
                    int pid = 0;
                    int n1 = 0;
                    int n2 = 0;
                    int n3 = 0;
                    int n4 = 0;


                    bool ok =
                        TryParseInt(
                            SafeSubstring(rawLine, 0, 8),
                            out eid
                        ) &&
                        TryParseInt(
                            SafeSubstring(rawLine, 8, 8),
                            out pid
                        ) &&
                        TryParseInt(
                            SafeSubstring(rawLine, 16, 8),
                            out n1
                        ) &&
                        TryParseInt(
                            SafeSubstring(rawLine, 24, 8),
                            out n2
                        ) &&
                        TryParseInt(
                            SafeSubstring(rawLine, 32, 8),
                            out n3
                        );


                    if (!ok)
                        continue;


                    if (pid != targetPartId)
                        continue;


                    if (rawLine.Length >= 48)
                    {
                        TryParseInt(
                            SafeSubstring(rawLine, 40, 8),
                            out n4
                        );
                    }


                    ElementData e =
                        new ElementData();

                    e.Id = eid;
                    e.PartId = pid;

                    e.N1 = n1;
                    e.N2 = n2;
                    e.N3 = n3;
                    e.N4 = n4;

                    elements.Add(e);
                }
            }
        }


        // ============================================================
        // Diagnostics
        // ============================================================

        Print("Target Part ID : " + targetPartId);
        Print("Parsed NODE count : " + nodes.Count);
        Print("NODE parse failures : " + nodeParseFailCount);
        Print("Selected ELEMENT count : " + elements.Count);


        if (nodes.Count == 0)
        {
            Print("ERROR: No NODE data could be parsed.");
            a = null;
            return;
        }


        if (elements.Count == 0)
        {
            Print(
                "ERROR: No *ELEMENT_SHELL found for Part ID " +
                targetPartId
            );

            a = null;
            return;
        }


        // ============================================================
        // Collect used Node IDs
        // ============================================================

        HashSet<int> usedNodeIds =
            new HashSet<int>();


        foreach (ElementData e in elements)
        {
            usedNodeIds.Add(e.N1);
            usedNodeIds.Add(e.N2);
            usedNodeIds.Add(e.N3);

            if (e.N4 > 0)
                usedNodeIds.Add(e.N4);
        }


        // ============================================================
        // Create ONE Rhino Mesh
        // ============================================================

        Mesh mesh =
            new Mesh();


        Dictionary<int, int> nodeToVertex =
            new Dictionary<int, int>();


        // ============================================================
        // Vertices
        // ============================================================

        int missingNodeCount = 0;


        foreach (
            int nodeId in
            usedNodeIds.OrderBy(id => id)
        )
        {
            Point3d pt;

            if (!nodes.TryGetValue(nodeId, out pt))
            {
                missingNodeCount++;

                // Avoid printing thousands of warnings
                if (missingNodeCount <= 20)
                {
                    Print(
                        "Missing Node ID : " +
                        nodeId
                    );
                }

                continue;
            }


            int vertexIndex =
                mesh.Vertices.Count;


            mesh.Vertices.Add(pt);


            nodeToVertex[nodeId] =
                vertexIndex;
        }


        // ============================================================
        // Faces
        // ============================================================

        int skippedElementCount = 0;


        foreach (ElementData e in elements)
        {
            int v1;
            int v2;
            int v3;


            if (
                !nodeToVertex.TryGetValue(e.N1, out v1) ||
                !nodeToVertex.TryGetValue(e.N2, out v2) ||
                !nodeToVertex.TryGetValue(e.N3, out v3)
            )
            {
                skippedElementCount++;
                continue;
            }


            // --------------------------------------------------------
            // Triangle
            // --------------------------------------------------------

            if (
                e.N4 <= 0 ||
                e.N4 == e.N3
            )
            {
                mesh.Faces.AddFace(
                    v1,
                    v2,
                    v3
                );

                continue;
            }


            // --------------------------------------------------------
            // Quad
            // --------------------------------------------------------

            int v4;


            if (
                !nodeToVertex.TryGetValue(e.N4, out v4)
            )
            {
                skippedElementCount++;
                continue;
            }


            mesh.Faces.AddFace(
                v1,
                v2,
                v3,
                v4
            );
        }


        // ============================================================
        // Finish mesh
        // ============================================================

        mesh.Vertices.CullUnused();

        mesh.FaceNormals.ComputeFaceNormals();
        mesh.Normals.ComputeNormals();

        mesh.Compact();


        // ============================================================
        // Result information
        // ============================================================

        Print("Used NODE count : " + usedNodeIds.Count);
        Print("Missing NODE count : " + missingNodeCount);

        Print("Mesh vertices : " + mesh.Vertices.Count);
        Print("Mesh faces : " + mesh.Faces.Count);

        Print(
            "Skipped elements : " +
            skippedElementCount
        );

        Print(
            "Mesh IsValid : " +
            mesh.IsValid
        );


        if (missingNodeCount > 20)
        {
            Print(
                "... plus " +
                (missingNodeCount - 20) +
                " more missing nodes."
            );
        }


        // ============================================================
        // Output ONE mesh
        // ============================================================

        if (mesh.Faces.Count == 0)
        {
            Print("ERROR: Mesh contains no faces.");
            a = null;
            return;
        }


        a = mesh;
    }


    // ================================================================
    // Element data
    // ================================================================

    private class ElementData
    {
        public int Id;
        public int PartId;

        public int N1;
        public int N2;
        public int N3;
        public int N4;
    }


    // ================================================================
    // Normal delimiter split
    // ================================================================

    private string[] SplitLine(string line)
    {
        return line.Split(
            new char[]
            {
                ' ',
                '\t',
                ','
            },
            StringSplitOptions.RemoveEmptyEntries
        );
    }


    // ================================================================
    // Safe fixed-width substring
    // ================================================================

    private string SafeSubstring(
        string text,
        int start,
        int length
    )
    {
        if (string.IsNullOrEmpty(text))
            return "";

        if (start < 0)
            return "";

        if (start >= text.Length)
            return "";

        int available =
            Math.Min(
                length,
                text.Length - start
            );


        return text.Substring(
            start,
            available
        ).Trim();
    }


    // ================================================================
    // Integer parser
    // ================================================================

    private bool TryParseInt(
        string text,
        out int value
    )
    {
        return int.TryParse(
            text.Trim(),
            NumberStyles.Integer,
            CultureInfo.InvariantCulture,
            out value
        );
    }


    // ================================================================
    // Double parser
    // ================================================================

    private bool TryParseDouble(
        string text,
        out double value
    )
    {
        return double.TryParse(
            text.Trim(),
            NumberStyles.Float,
            CultureInfo.InvariantCulture,
            out value
        );
    }
}
# ---------- end extruct_mesh_pid ----------
merge = Merge(Data1=circle_2, Data2=circle)
mesh_flip = MeshFlip(Mesh=extruct_mesh_pid.a)
mesh = Mesh(mesh_flip)
panel = Panel(extruct_section_shell_pid.T1)
boundary_surfaces = BoundarySurfaces(Edges=merge)
boundary_surfaces_2 = BoundarySurfaces(Edges=circle_2)
抑え面圧_mpa = Slider(1, range=0..10)
bounding_box = BoundingBox(Content=mesh, Plane=PlaneXY(0, 0, 0))  # -> Box, Box_2
panel_2 = Panel(extruct_mesh_pid.out)
mesh_naked_edges = MeshNakedEdges(Mesh=mesh)  # -> Naked, ResultBoolean
deconstruct_box = DeconstructBox(Box=bounding_box.Box)  # -> Plane, X, Y, Z
brank = Brep(boundary_surfaces_2)
division = Division(A=panel, B=2)
unit_z = UnitZ(Factor=division)
move = Move(Geometry=boundary_surfaces, Motion=unit_z)  # -> Geometry, Transform
merge_2 = Merge(Data1=circle_2, Data2=mesh_naked_edges.Naked)  # -> flatten(Result)
deconstruct_domain = DeconstructDomain(Domain=deconstruct_box.Z)  # -> Start, End
offset_mesh = OffsetMesh(Mesh=mesh, Distance=division, BothSides=expr("-x", division), CreateSolid=Toggle(False))
unit_z_2 = UnitZ(Factor=division)  # -> expr("-x", UnitVector)
boundary_surfaces_3 = BoundarySurfaces(Edges=merge_2)
osae = Brep(move.Geometry)
area = Area(Geometry=osae)  # -> Area, Centroid
multiplication = Multiplication(A=抑え面圧_mpa, B=area.Area)
パーツ荷重_n = Panel(multiplication)
subtraction = Subtraction(A=deconstruct_domain.End, B=deconstruct_domain.Start)
brep_punch2_fix = Brep(boundary_surfaces_3)
stroke = Number(subtraction)
box_properties = BoxProperties(Box=offset_mesh)  # -> Center, Diagonal, Area, Volume, Degeneracy
quad_remesh_settings = QuadRemeshSettings(
    TargetCount=Slider(2000, range=0..10000),
    AdaptiveSize=0,
    AdaptiveCount=False,
    HardEdges=False,
    SeamEdges=0,
    Symmetry=0,
    GuideCurves=0)
quad_remesh_settings_2 = QuadRemeshSettings(
    TargetCount=Slider(6000, range=0..10000),
    AdaptiveSize=0,
    AdaptiveCount=False,
    HardEdges=False,
    SeamEdges=0,
    Symmetry=0,
    GuideCurves=0)
move_2 = Move(Geometry=brep_punch2_fix, Motion=unit_z_2)  # -> Geometry, Transform
deconstruct = Deconstruct(Point=box_properties.Center)  # -> XComponent, YComponent, ZComponent
unit_z_3 = UnitZ(Factor=stroke)
quad_remesh = QuadRemesh(Geometry=move_2.Geometry, Settings=quad_remesh_settings)
sort_list = SortList(Keys=deconstruct.ZComponent, ValuesValuesA=offset_mesh)  # -> Keys, ValuesValuesA
quad_remesh_2 = QuadRemesh(Geometry=osae, Settings=quad_remesh_settings)
quad_remesh_3 = QuadRemesh(Geometry=brank, Settings=quad_remesh_settings_2)
list_item = ListItem(List=sort_list.ValuesValuesA, Index=0, Wrap=True)  # -> Item, Item1
mesh_punch1_move = Mesh(list_item.Item1)
mesh_punch2_fix = Mesh(list_item.Item)
merge_3 = Merge(Data1=mesh_punch2_fix, Data2=quad_remesh)  # -> flatten(Result)
mesh_join = MeshJoin(Meshes=merge_3)
move_3 = Move(Geometry=mesh_punch1_move, Motion=unit_z_3)  # -> Geometry, Transform
mesh_punch2_fix_2 = Mesh(mesh_join)
mmesh_from_mesh = MMeshFromMesh(Mesh=quad_remesh_3, MakeQuadratic=False)
mmesh_from_mesh_2 = MMeshFromMesh(Mesh=mesh_punch2_fix_2, MakeQuadratic=False)
mmesh_from_mesh_3 = MMeshFromMesh(Mesh=move_3.Geometry, MakeQuadratic=False)
mmesh_from_mesh_4 = MMeshFromMesh(Mesh=quad_remesh_2, MakeQuadratic=False)
panel_3 = Panel("""*DEFINE_CURVE_TITLE
Part2 move
$        i         i         f         f         f         f
$     lcid      sidr      scla      sclo      offa      offo
$#    lcid      sidr       sfa       sfo      offa      offo    dattyp     lcint
         2         0       0.0       0.0       0.0       0.0         0         0
$#                a1                  o1  
                 0.0                 0.0
                0.01                 0.0
                 0.1{0:20}
                 0.2{0:20}""")
extruct_section_shell_pid_2 = CSharpScript(kfile_text=read_file, PID=number_slider)  # -> out, MID, MAT_keyword, MAT_text; inputs kfile_text: String, PID: Int32
# ---------- extruct_section_shell_pid_2: C# ----------
// Grasshopper Script Instance
#region Usings
using System;
using System.Linq;
using System.Collections;
using System.Collections.Generic;
using System.Drawing;
using System.Globalization;
using System.Text;

using Rhino;
using Rhino.Geometry;

using Grasshopper;
using Grasshopper.Kernel;
using Grasshopper.Kernel.Data;
using Grasshopper.Kernel.Types;
#endregion

public class Script_Instance : GH_ScriptInstance
{
    #region Notes
    /* 
      Members:
        RhinoDoc RhinoDocument
        GH_Document GrasshopperDocument
        IGH_Component Component
        int Iteration

      Methods (Virtual & overridable):
        Print(string text)
        Print(string format, params object[] args)
        Reflect(object obj)
        Reflect(object obj, string method_name)
    */
    #endregion


    private void RunScript(
		string kfile_text,
		int PID,
		ref object MID,
		ref object MAT_keyword,
		ref object MAT_text)
    {
        MID = null;
        MAT_keyword = null;
        MAT_text = null;


        if (string.IsNullOrWhiteSpace(kfile_text))
        {
            Print("kfile_text is empty.");
            return;
        }


        string[] lines =
            kfile_text.Replace("\r\n", "\n")
                      .Replace("\r", "\n")
                      .Split('\n');


        // ============================================================
        // STEP 1
        // PID -> MID from *PART
        // ============================================================

        int targetMID = -1;

        bool insidePart = false;


        for (int i = 0; i < lines.Length; i++)
        {
            string rawLine = lines[i];

            if (rawLine == null)
                continue;


            string line = rawLine.Trim();


            if (line.Length == 0)
                continue;


            // --------------------------------------------------------
            // Keyword
            // --------------------------------------------------------

            if (line.StartsWith("*"))
            {
                insidePart =
                    line.StartsWith(
                        "*PART",
                        StringComparison.OrdinalIgnoreCase
                    );

                continue;
            }


            if (!insidePart)
                continue;


            // --------------------------------------------------------
            // Skip comments
            // --------------------------------------------------------

            if (line.StartsWith("$"))
                continue;


            // --------------------------------------------------------
            // PART data
            //
            // PID SECID MID ...
            // --------------------------------------------------------

            int partPID = 0;
            int partSECID = 0;
            int partMID = 0;


            if (
                TryParsePartLine(
                    rawLine,
                    out partPID,
                    out partSECID,
                    out partMID
                )
            )
            {
                if (partPID == PID)
                {
                    targetMID = partMID;
                    break;
                }
            }
        }


        // ============================================================
        // PID not found
        // ============================================================

        if (targetMID < 0)
        {
            Print(
                "PID " +
                PID +
                " was not found in *PART."
            );

            return;
        }


        MID = targetMID;


        Print("PID : " + PID);
        Print("MID : " + targetMID);


        // ============================================================
        // STEP 2
        // Search all *MAT_* blocks
        // ============================================================

        for (int i = 0; i < lines.Length; i++)
        {
            string rawLine = lines[i];

            if (rawLine == null)
                continue;


            string line =
                rawLine.Trim();


            // --------------------------------------------------------
            // MAT keyword
            // --------------------------------------------------------

            if (
                line.StartsWith(
                    "*MAT",
                    StringComparison.OrdinalIgnoreCase
                )
            )
            {
                string keyword = line;


                // ----------------------------------------------------
                // Collect this MAT block
                // ----------------------------------------------------

                List<string> block =
                    new List<string>();


                block.Add(rawLine);


                int j = i + 1;


                while (j < lines.Length)
                {
                    string nextRaw =
                        lines[j];


                    if (nextRaw == null)
                    {
                        block.Add("");
                        j++;
                        continue;
                    }


                    string next =
                        nextRaw.Trim();


                    // New keyword = end of MAT block
                    if (next.StartsWith("*"))
                        break;


                    block.Add(nextRaw);

                    j++;
                }


                // ----------------------------------------------------
                // Check MID inside this MAT block
                // ----------------------------------------------------

                int matMID = -1;


                if (
                    TryGetMatMID(
                        block,
                        out matMID
                    )
                )
                {
                    if (matMID == targetMID)
                    {
                        MAT_keyword = keyword;
                        MAT_text = JoinLines(block);

                        Print(
                            "MAT found : " +
                            keyword
                        );

                        return;
                    }
                }


                // Skip block already checked
                i = j - 1;
            }
        }


        // ============================================================
        // MAT not found
        // ============================================================

        Print(
            "No *MAT keyword with MID " +
            targetMID +
            " was found."
        );
    }


    // ================================================================
    // Parse PART
    //
    // PID SECID MID ...
    // ================================================================

    private bool TryParsePartLine(
        string rawLine,
        out int pid,
        out int secid,
        out int mid
    )
    {
        pid = 0;
        secid = 0;
        mid = 0;


        // ------------------------------------------------------------
        // 1. Normal whitespace / comma separated
        // ------------------------------------------------------------

        string[] values =
            SplitLine(
                rawLine.Trim()
            );


        if (values.Length >= 3)
        {
            int p = 0;
            int s = 0;
            int m = 0;


            if (
                TryParseInt(values[0], out p) &&
                TryParseInt(values[1], out s) &&
                TryParseInt(values[2], out m)
            )
            {
                pid = p;
                secid = s;
                mid = m;

                return true;
            }
        }


        // ------------------------------------------------------------
        // 2. Fixed width 10
        // ------------------------------------------------------------

        if (rawLine.Length >= 30)
        {
            int p = 0;
            int s = 0;
            int m = 0;


            if (
                TryParseInt(
                    SafeSubstring(rawLine, 0, 10),
                    out p
                ) &&
                TryParseInt(
                    SafeSubstring(rawLine, 10, 10),
                    out s
                ) &&
                TryParseInt(
                    SafeSubstring(rawLine, 20, 10),
                    out m
                )
            )
            {
                pid = p;
                secid = s;
                mid = m;

                return true;
            }
        }


        // ------------------------------------------------------------
        // 3. Fixed width 8
        // ------------------------------------------------------------

        if (rawLine.Length >= 24)
        {
            int p = 0;
            int s = 0;
            int m = 0;


            if (
                TryParseInt(
                    SafeSubstring(rawLine, 0, 8),
                    out p
                ) &&
                TryParseInt(
                    SafeSubstring(rawLine, 8, 8),
                    out s
                ) &&
                TryParseInt(
                    SafeSubstring(rawLine, 16, 8),
                    out m
                )
            )
            {
                pid = p;
                secid = s;
                mid = m;

                return true;
            }
        }


        return false;
    }


    // ================================================================
    // Get MID from MAT block
    //
    // Assumption:
    // The first non-comment numeric data line
    // contains MID as its first field.
    //
    // This is valid for standard LS-DYNA *MAT keywords.
    // ================================================================

    private bool TryGetMatMID(
        List<string> block,
        out int mid
    )
    {
        mid = -1;


        if (block == null)
            return false;


        foreach (string rawLine in block)
        {
            if (rawLine == null)
                continue;


            string line =
                rawLine.Trim();


            if (line.Length == 0)
                continue;


            // Keyword
            if (line.StartsWith("*"))
                continue;


            // Comment
            if (line.StartsWith("$"))
                continue;


            // --------------------------------------------------------
            // First try split format
            // --------------------------------------------------------

            string[] values =
                SplitLine(line);


            if (values.Length >= 1)
            {
                int m = 0;


                if (
                    TryParseInt(
                        values[0],
                        out m
                    )
                )
                {
                    mid = m;
                    return true;
                }
            }


            // --------------------------------------------------------
            // Fixed width 10
            // --------------------------------------------------------

            if (rawLine.Length >= 10)
            {
                int m = 0;


                if (
                    TryParseInt(
                        SafeSubstring(
                            rawLine,
                            0,
                            10
                        ),
                        out m
                    )
                )
                {
                    mid = m;
                    return true;
                }
            }


            // --------------------------------------------------------
            // Fixed width 8
            // --------------------------------------------------------

            if (rawLine.Length >= 8)
            {
                int m = 0;


                if (
                    TryParseInt(
                        SafeSubstring(
                            rawLine,
                            0,
                            8
                        ),
                        out m
                    )
                )
                {
                    mid = m;
                    return true;
                }
            }


            // If first actual data line cannot be parsed as MID,
            // stop checking this MAT block.
            return false;
        }


        return false;
    }


    // ================================================================
    // Join original lines
    // ================================================================

    private string JoinLines(
        List<string> lines
    )
    {
        StringBuilder sb =
            new StringBuilder();


        for (int i = 0; i < lines.Count; i++)
        {
            sb.Append(lines[i]);

            if (i < lines.Count - 1)
                sb.AppendLine();
        }


        return sb.ToString();
    }


    // ================================================================
    // Split
    // ================================================================

    private string[] SplitLine(
        string line
    )
    {
        return line.Split(
            new char[]
            {
                ' ',
                '\t',
                ','
            },
            StringSplitOptions.RemoveEmptyEntries
        );
    }


    // ================================================================
    // Safe fixed-width substring
    // ================================================================

    private string SafeSubstring(
        string text,
        int start,
        int length
    )
    {
        if (string.IsNullOrEmpty(text))
            return "";


        if (start < 0)
            return "";


        if (start >= text.Length)
            return "";


        int available =
            Math.Min(
                length,
                text.Length - start
            );


        return text.Substring(
            start,
            available
        ).Trim();
    }


    // ================================================================
    // Integer parser
    // ================================================================

    private bool TryParseInt(
        string text,
        out int value
    )
    {
        value = 0;


        if (string.IsNullOrWhiteSpace(text))
            return false;


        return int.TryParse(
            text.Trim(),
            NumberStyles.Integer,
            CultureInfo.InvariantCulture,
            out value
        );
    }
}
# ---------- end extruct_section_shell_pid_2 ----------
panel_4 = Panel("2")
shell_from_mmesh_node_element_shell_tore = ShellFromMMeshNODEELEMENT_SHELLToreo(MMeshMiner=mmesh_from_mesh_2, PartPartIndex="4", TranslationalConstraint=0, RotationalConstraint=0)  # -> NodeWriterToreo, ElementWriterToreo
shell_from_mmesh_node_element_shell_tore_2 = ShellFromMMeshNODEELEMENT_SHELLToreo(MMeshMiner=mmesh_from_mesh_3, PartPartIndex="2", TranslationalConstraint=0, RotationalConstraint=0)  # -> NodeWriterToreo, ElementWriterToreo
shell_from_mmesh_node_element_shell_tore_3 = ShellFromMMeshNODEELEMENT_SHELLToreo(MMeshMiner=mmesh_from_mesh_4, PartPartIndex="3", TranslationalConstraint=0, RotationalConstraint=0)  # -> NodeWriterToreo, ElementWriterToreo
shell_from_mmesh_node_element_shell_tore_4 = ShellFromMMeshNODEELEMENT_SHELLToreo(MMeshMiner=mmesh_from_mesh, PartPartIndex="1", TranslationalConstraint=0, RotationalConstraint=0)  # -> NodeWriterToreo, ElementWriterToreo
panel_5 = Panel(extruct_section_shell_pid_2.MAT_text)
define_part_part_toreo = DefinePartPARTToreo(PartIndex="1", SectionSectionIndex="1", MaterialMaterialIndex="1")
define_shell_section_section_shell_toreo = DefineShellSectionSECTION_SHELLToreo(
    SectionIndex=extruct_section_shell_pid.SECID,
    ELFORM=extruct_section_shell_pid.ELEFORM,
    SHRF=1,
    NIP=2,
    QR_IRID=0,
    ICOMP=0,
    T1=extruct_section_shell_pid.T1,
    T2=extruct_section_shell_pid.T2,
    T3=extruct_section_shell_pid.T3,
    T4=extruct_section_shell_pid.T4,
    NLOC=0,
    MAREA=0,
    IDOF=0,
    EDGSET=0,
    LengthUnit="""{
  "$type": "MinerGH.Kernel.Unit.MUnit, MinerGH",
  "LengthDim": 1,
  "MassDim": 0,
  "TimeDim": 0,
  "ElectricCurrentDim": 0,
  "TemperatureDim": 0,
  "AmountOfSubstanceDim": 0,
  "LuminousIntensityDim": 0,
  "Power": -3,
  "Label": "MilM",
  "IsUndefined": false
}""")
arbitrary_lines_with_replacements_toreo = ArbitraryLinesWithReplacementsToreo(Text=extruct_section_shell_pid_2.MAT_text)
number = Number(stroke)
arbitrary_lines_with_replacements_toreo_2 = ArbitraryLinesWithReplacementsToreo(Text=panel_3, Data0=number)
include_include_toreo = IncludeINCLUDEToreo(FilePathToInclude="../cal_setup.k")
merge_4 = Merge(
    Data1=shell_from_mmesh_node_element_shell_tore_2.NodeWriterToreo,
    Data2=shell_from_mmesh_node_element_shell_tore_2.ElementWriterToreo,
    Data3=shell_from_mmesh_node_element_shell_tore_3.NodeWriterToreo,
    Data4=shell_from_mmesh_node_element_shell_tore_3.ElementWriterToreo,
    Data5=shell_from_mmesh_node_element_shell_tore.NodeWriterToreo,
    Data6=shell_from_mmesh_node_element_shell_tore.ElementWriterToreo)  # -> flatten(Result)
merge_5 = Merge(
    Data1=define_part_part_toreo,
    Data2=shell_from_mmesh_node_element_shell_tore_4.NodeWriterToreo,
    Data3=shell_from_mmesh_node_element_shell_tore_4.ElementWriterToreo,
    Data4=define_shell_section_section_shell_toreo,
    Data5=arbitrary_lines_with_replacements_toreo)  # -> flatten(Result)
panel_6 = Panel("E:\Develop\260918_Lab_FormingInsight_process01\process_press-z\input_run")
assemble_direct_keyword_parser_toreo = AssembleDirectKeywordParserToreo(
    KeywordWriterToreo=include_include_toreo,
    KeywordWriterToreo_2=arbitrary_lines_with_replacements_toreo_2,
    KeywordWriterToreo_3=merge_4,
    KeywordWriterToreo_4=merge_5)
list = ValueList({"M(0)": 0, "KM(3)": 3, "MilM(-3)": -3, "CM(-2)": -2}, selected="MilM(-3)")
list_2 = ValueList({"KG(0)": 0, "TON(3)": 3, "MilG(-6)": -6, "G(-3)": -3}, selected="TON(3)")
list_3 = ValueList({"SEC(0)": 0, "MicroSEC(-6)": -6, "MilSEC(-3)": -3}, selected="SEC(0)")
list_4 = ValueList({"K(0)": 0}, selected="K(0)")
list_5 = ValueList({"A(0)": 0, "KA(3)": 3, "MilA(-3)": -3}, selected="A(0)")
get_file_path_cal_directory = GetFilePath(AtLeast=1, AtMost=1, TreeAccess=False)
list_6 = ValueList({"Overwrite(1)": 1, "IncrementSubDirectory(2)": 2, "OverwriteInSubDir(3)": 3}, selected="Overwrite(1)")
unit_system_miner = UnitSystemMiner(Length=list, Weight=list_2, Time=list_3, Temperature=list_4, ElectricCurrent=list_5)
button = Button()
list_7 = ValueList({"M(0)": 0, "KM(3)": 3, "MilM(-3)": -3, "CM(-2)": -2}, selected="MilM(-3)")
write_keyword_file_toreo = WriteKeywordFileToreo(
    KeywordParserToreo=assemble_direct_keyword_parser_toreo,
    ModelLengthUnit=list_7,
    UnitSystemToConvertTo=unit_system_miner,
    Write=Toggle(True),
    Directory=get_file_path_cal_directory,
    FileName="input",
    Extension=".k",
    WriteEND=True,
    NodeIndexOffset=0,
    ElementIndexOffset=0,
    PartIndexOffset=0,
    MaterialIndexOffset=0,
    SetIndexOffset=0,
    FuctionIndexOffset=0,
    WriteMode=list_6)  # -> WrittenFilePath, port, Log
list_8 = ValueList({"Single(0)": 0, "Double(1)": 1}, selected="Single(0)")
list_9 = ValueList({"SMP(0)": 0, "MPP_IntelMPI(1)": 1, "MPP_MSMPI(2)": 2}, selected="SMP(0)")
list_10 = ValueList({"Normal", "Hidden", "Minimized", "Maximized"}, selected="Normal")
list_11 = ValueList({"Overwrite(1)": 1, "IncrementSubDirectory(2)": 2, "OverwriteInSubDir(3)": 3}, selected="Overwrite(1)")
list_12 = ValueList({"LSTC(0)": 0, "ANSYS(1)": 1}, selected="ANSYS(1)")
path_2 = FilePath(write_keyword_file_toreo.WrittenFilePath)
rundynasync = RunDynaSyncToreo(
    KeywordFilePath=path_2,
    NumOfCpu=Slider(8, range=0..10),
    NumOfMemoryMB=Slider(453, range=0..1000),
    Precision=list_8,
    Parallelization=list_9,
    WindowStyle=list_10,
    Run=Toggle(True),
    MaxParallelization=1,
    WriteMode=list_11,
    LicenseTarget=list_12,
    LSTCServerHostName="calvados.internal.nature-architects.com")
panel_7 = Panel(rundynasync)
c_print = ContextPrint(Text=rundynasync)
