# Grasshopper definition process_test.gh (Grasshopper 1.0.8)
# plug-ins: Logger, MinerGH

loggermanager = LoggerManager()
get_file_path = GetFilePath(AtLeast=1, AtMost=1, TreeAccess=False)
list = ValueList({"Single(0)": 0, "Double(1)": 1}, selected="Single(0)")
list_2 = ValueList({"SMP(0)": 0, "MPP_IntelMPI(1)": 1, "MPP_MSMPI(2)": 2}, selected="SMP(0)")
list_3 = ValueList({"Normal", "Hidden", "Minimized", "Maximized"}, selected="Hidden")
list_4 = ValueList({"Overwrite(1)": 1, "IncrementSubDirectory(2)": 2, "OverwriteInSubDir(3)": 3}, selected="Overwrite(1)")
list_5 = ValueList({"LSTC(0)": 0, "ANSYS(1)": 1}, selected="ANSYS(1)")
path = FilePath(get_file_path)
rundynasync = RunDynaSyncToreo(
    KeywordFilePath=path,
    NumOfCpu=1,
    NumOfMemoryMB=20,
    Precision=list,
    Parallelization=list_2,
    WindowStyle=list_3,
    Run=Toggle(True),
    MaxParallelization=1,
    WriteMode=list_4,
    LicenseTarget=list_5,
    LSTCServerHostName="calvados.internal.nature-architects.com")
panel = Panel(rundynasync)
c_print = ContextPrint(Text=rundynasync)
